vi "index.gviweb"   [G Web Development Software 22.0.0]
panel controls:
  "Bryter 1": bool = TRUE
  "Bryter 2": bool
  "Bryter 3": bool = TRUE
  "Bryter 4": bool
panel indicators:
  "Eksempel OG funksjon": string
  "LED": bool
  "LED_2": bool
  "LED_3": bool
  "eksempel ELLER funksjon": string
  "LED_4": bool
  "LED_5": bool
  "LED_6": bool
diagram:
  # Place setup code before the loop. For example, perform initial data communication and wire the results into the loop.
  # Top-Level WebVIs usually contain a While Loop that never stops so that they can continue running as long as the web page is open in the user's web browser.
  while {
    $LED <- $"Bryter 1"
    Logical And($"Bryter 1", $"Bryter 2") -> w1
    $LED_3 <- w1
    $LED_2 <- $"Bryter 2"
    $LED_4 <- $"Bryter 4"
    Logical Or($"Bryter 4", $"Bryter 3") -> w2
    $LED_6 <- w2
    Wait(time to wait=50)
    $LED_5 <- $"Bryter 3"
    stop if FALSE
  }
